# Grasshopper definition test_model.gh (Grasshopper 1.0.8)

box_2pt = Box2Pt(PointA="-10,-10,0", PointB="10,10,3", Plane=PlaneXY(0, 0, 0))
box_2pt_2 = Box2Pt(PointA="-10,-10,3", PointB="5,5,6", Plane=PlaneXY(0, 0, 0))
brep = Brep(box_2pt)
brep_2 = Brep(box_2pt_2)
intsolid = HBIntersectSolids(rooms=flatten([brep, brep_2]), run=Toggle(True))  # -> int_rooms; plug-in component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
roomsolid = HBRoomFromSolid(geo=flatten(intsolid), conditioned=True)  # -> out, rooms; plug-in component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
explode_tree = ExplodeTree(Data=graft(roomsolid.rooms))  # -> Branch0, Branch1
aperturesbyratio = HBAperturesByRatio(hb_objs=flatten(explode_tree.Branch1), ratio=Slider(0.2, range=0..1), subdivide=Slider(1.6, range=0.1..2))  # -> out, hb_objs; plug-in component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
aperturesbyratio_2 = HBAperturesByRatio(hb_objs=flatten(explode_tree.Branch0), ratio=Slider(0.6, range=0..1), subdivide=Slider(0.9, range=0.1..2))  # -> out, hb_objs; plug-in component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
merge = Merge(Data1=aperturesbyratio_2.hb_objs, Data2=aperturesbyratio.hb_objs)
vizbytype = HBVisualizeByType(hb_objs=merge)  # -> walls, interior_walls, roofs, ceilings, exterior_floors, interior_floors, air_walls, apertures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; plug-in component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
create_spaces_from_rooms = HBPHCreateSpacesFromHBRooms(hb_rooms=merge)  # -> out, hb_rooms; inputs hb_rooms: list; plug-in component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
solveadj = HBSolveAdjacency(rooms=flatten(create_spaces_from_rooms.hb_rooms), run=Toggle(True))  # -> out, adj_rooms; plug-in component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
model = HBModel(rooms=flatten(solveadj.adj_rooms), name="This is a Test Model")  # -> out, model; plug-in component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
file_path = FilePath("/Users/em/Dropbox/bldgtyp-00/00_PH_Tools/ph_navigator/backend/")
dumpobjects = HBDumpObjects(hb_objs=flatten(model.model), name="test_model", folder=file_path, dump=Toggle(True))  # -> out, hb_file; plug-in component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
